vi "FormatGrid.gvi"   [LabVIEW NXG 2.1.0]
inputs:
  "ramp": f64[]
  "Error In": error
  "load": f64[]
outputs:
  "Data Grid": T1[]
  "Error Out": error
types:
  T1 = cluster{"Battery": string, "Ramp": f64, "Load": f64, "Trend": string, "Status": string}
diagram:
  for {
    w1 = each element of $ramp
    w2 = each element of ["1", "2", "3\n", "4", "5", "6"]
    w3 = each element of $load
    s1 = w1  # shift register
    while {
      Is Greater(x=w1, y=s1) -> w5
      Select(s=w5, t="↗️", f="🐗") -> w6
      w7 = T1 {"Battery"="One", "Ramp"=4.822939, "Load"=0, "Trend"="↗️", "Status"="🐗"}
      Property Node(instance in=w7, "Battery"=w2, "Ramp"=w1, "Trend"=w6, "Load"=w3, "Status"="🐗") -> (instance out=w8)
      next s1 = w1
      stop if TRUE
    }
    append w8 to w4
  }
  $"Data Grid" <- w4
  $"Error Out" <- $"Error In"
