vi "Read Example Tags.gvi"   [LabVIEW NXG 2.1.0]
inputs:
  "error in": error
  "SystemLink Connection": T1
outputs:
  "error out": error
  "ramp": f64[]
  "load": f64[]
  "SystemLink Connection out": T1
types:
  "DataType.gtype" = enum{"Double", "Integer", "String"}
  "Tag.gtype" = cluster{"Path": string, "Datatype": "DataType.gtype", "Configuration": "Configuration.gtype"}
  "Message Session.gtype" = cluster{"Configuration": "Configuration.gtype", "token": string}
  T1 = cluster{"Tags": "Tag.gtype"[], "Message Topic": string, "Message Configuration": "Message Session.gtype"}
uses:
  NI::Skyline::TagHTTP::Query Tags.gvi
  NI::Skyline::TagHTTP::Multi Read.gvi
diagram:
  $"SystemLink Connection out" <- $"SystemLink Connection"
  Property Node(instance in=$"SystemLink Connection") -> ("Tags"=w1)
  case ($"error in") {
    frame Error, Default {
      w2 = $"error in"
      w3 = f64[] []
      w4 = f64[] []
    }
    frame No Error {
      Array Index(array=w1) -> (out0[_]=w5)
      Property Node(instance in=w5) -> ("Configuration"=w6)
      call "Query Tags.gvi"(paths=["customizingwebvis.battery.load.*"], error in=$"error in", configuration=w6) -> (tags=w7, error out=w8)
      call "Multi Read.gvi"(tags in=w7, error in=w8) -> (tags out=w9, tag clusters=w10, error out=w11)
      for {
        w12 = each element of w10
        disable {
          frame Disabled {
            Random Number() -> (number (0 to 1)=w13)
          }
          frame Enabled {
            Property Node(instance in=w12) -> ("Value"=w15)
            Scan From String(inputString=w15, errIn=w11) -> (errOut=w14, out0=w13)
          }
        }
        append w13 to w4
      }
      call "Query Tags.gvi"(paths=["customizingwebvis.battery.ramp.*"], error in=$"error in", configuration=w6) -> (tags=w16, error out=w17)
      call "Multi Read.gvi"(tags in=w16, error in=w17) -> (tag clusters=w18, error out=w19)
      for {
        w20 = each element of w18
        disable {
          frame Disabled {
            Random Number() -> (number (0 to 1)=w21)
          }
          frame Enabled {
            Property Node(instance in=w20) -> ("Value"=w23)
            Scan From String(inputString=w23, errIn=w19) -> (errOut=w22, out0=w21)
          }
        }
        append w21 to w3
      }
      Merge Errors(w14, w22) -> (error out=w2)
      Array Size(array=w9)
    }
  }
  $"error out" <- w2
  $ramp <- w3
  $load <- w4
